# Grasshopper definition A2_GH Script_Rodrigo Tarriba.gh (Grasshopper 1.0.7)

number_slider = Slider(10, range=0..100)
number_of_ribs = Slider(10, range=5..20)
base_thickness = Slider(10, range=10..40)
pieces_per_rib = Slider(18, range=10..20)
max_rotation = Slider(85, range=30..90)
min_rotation = Slider(10, range=10..90)
# Parameters
frame_side = Slider(219, range=200..400)
end_extensions = Slider(10, range=10..40)
cardboard_thickness = Slider(1.24, range=1..3)
bone_lenght = Slider(10, range=10..20)
referencecurve = Curve(<curve referenced from the Rhino model>)

# ---- group: Create circle in the appropiate orientation
xy = XYPlane(Origin=Point(0, 0, 0))
circle = CircleCNR(Center=xy, Normal=Vector(0, 0, 1), Radius=number_slider)
Y = UnitY(Factor=number_slider)
move = Move(Geometry=circle, Motion=Y)  # -> Geometry, Transform
xz = XZPlane(Origin=Point(0, 0, 0))
rotate = Rotate(Geometry=circle, Angle=1.570796327, Plane=xz)  # -> Geometry, Transform

# ---- group: Create frame rectangle for model
rectangle = Rectangle(Plane=PlaneXY(0, 0, 0), XSize=frame_side, YSize=frame_side, Radius=0)  # -> Rectangle, Length

# ---- group: Bone piece (ensamblage)
division = Division(A=bone_lenght, B=2)
division_2 = Division(A=cardboard_thickness, B=2)
dom = ConstructDomain(DomainStart=expr("x*-1", division), DomainEnd=division)
dom_2 = ConstructDomain(DomainStart=expr("x*-1", division_2), DomainEnd=division_2)
rectangle_2 = Rectangle(Plane=PlaneXY(0, 0, 0), XSize=dom_2, YSize=dom, Radius=0)  # -> Rectangle, Length

# ---- group: Grab second (1) line in rectangle that creates ribs
explode = Explode(Curve=rectangle.Rectangle, Recursive=True)  # -> Segments, Vertices
num = Number(1)
item = ListItem(List=explode.Segments, Index=num, Wrap=True)
divide = DivideCurve(Curve=item, Count=number_of_ribs, Kinks=False)  # -> Points, Tangents, Parameters

# ----
Z = UnitZ(Factor=expr("x*-1", base_thickness))
ext = ExtendCurve(Curve=item, Type=0, Start=end_extensions, End=end_extensions)
extr = Extrude(Base=ext, Direction=Z)
boundary = BoundarySurfaces(Edges=rotate.Geometry)

# ---- group: Add circle for easy insertion into cardboard
area = Area(Geometry=rectangle_2.Rectangle)  # -> Area, Centroid
circle_2 = CircleCNR(Center=area.Centroid, Normal=Vector(0, 0, 1), Radius=expr("x*.60", cardboard_thickness))
runion = RegionUnion(Curves=[rectangle_2.Rectangle, circle_2])

# ---- group: Create Initial Ribs
boundary_2 = BoundarySurfaces(Edges=rectangle.Rectangle)
srf_cp = SurfaceClosestPoint(Point=divide.Points, Surface=boundary_2)  # -> Point, UVPoint, Distance
iso = IsoCurve(Surface=boundary_2, UVPoint=srf_cp.UVPoint)  # -> UIsocurve, VIsocurve
crv = Curve(simplify(iso.UIsocurve))

# ----
Z_2 = UnitZ(Factor=expr("x*-1", base_thickness))
ext_2 = ExtendCurve(Curve=crv, Type=0, Start=end_extensions, End=end_extensions)
extr_2 = Extrude(Base=ext_2, Direction=Z_2)

# ---- group: Create pieces except for start and end of the curve
divide_2 = DivideCurve(Curve=crv, Count=expr("x+1", pieces_per_rib), Kinks=False)  # -> Points, Tangents, Parameters
num_2 = Number(1)
split = SplitList(List=divide_2.Points, Index=num_2)  # -> ListA, simplify(ListB)
rev = ReverseList(List=split.ListB)
split_2 = SplitList(List=rev, Index=num_2)  # -> ListA, ListB
pt = Point(split_2.ListB)

# ----
crv_cp = CurveClosestPoint(Point=pt, Curve=referencecurve)  # -> Point, Parameter, Distance

# ---- group: Obtain longest distance to curve
sort = SortList(Keys=flatten(crv_cp.Distance))  # -> Keys, ValuesA
rev_2 = ReverseList(List=sort.Keys)
item_2 = ListItem(List=rev_2, Index=0, Wrap=True)  # -> flatten(Item)

# ---- group: Detect orientation of pieces depending on X position to curve
pdecon = Deconstruct(Point=pt)  # -> XComponent, YComponent, ZComponent
pdecon_2 = Deconstruct(Point=crv_cp.Point)  # -> XComponent, YComponent, ZComponent
subtraction = Subtraction(A=pdecon.XComponent, B=pdecon_2.XComponent)
smaller = SmallerThan(FirstNumber=subtraction, SecondNumber=0)  # -> SmallerThan, OrEqualTo

# ----
debrep = DeconstructBrep(Brep=extr_2)  # -> Faces, Edges, Vertices
join = JoinCurves(Curves=debrep.Edges, Preserve=False)  # -> simplify(Curves)

# ---- group: Orient and rotate pieces depending on the assigned curve
srf_cp_2 = SurfaceClosestPoint(Point=pt, Surface=extr_2)  # -> Point, UVPoint, Distance
evalsrf = EvaluateSurface(Surface=extr_2, Point=srf_cp_2.UVPoint)  # -> Point, Normal, UDirection, VDirection, Frame
orient = Orient(Geometry=runion, Source=PlaneXY(0, 0, 0), Target=evalsrf.Frame)  # -> Geometry, Transform

# ---- group: Obtain number of radians for each piece to rotate
subtraction_2 = Subtraction(A=max_rotation, B=min_rotation)
division_3 = Division(A=crv_cp.Distance, B=item_2)
subtraction_3 = Subtraction(A=1, B=division_3)
multiplication = Multiplication(A=subtraction_2, B=subtraction_3)

# ----
addition = Addition(A=multiplication, B=min_rotation)
sift = SiftPattern(List=addition, SiftPattern=smaller.SmallerThan)  # -> Output0, Output1
multiplication_2 = Multiplication(A=sift.Output1, B=-1)
combine = CombineData(Input0=sift.Output0, Input1=multiplication_2)  # -> Result, Index

# ---- group: Obtain number of radians for each piece to rotate (continued)
rad = Radians(Degrees=combine.Result)

# ---- group: Orient and rotate pieces depending on the assigned curve (continued)
rotate_2 = Rotate(Geometry=orient.Geometry, Angle=rad, Plane=evalsrf.Frame)  # -> simplify(Geometry), Transform

# ---- group: rotate pieces for laser cutting
rdiff = RegionDifference(CurvesA=join, CurvesB=rotate_2.Geometry)
area_2 = Area(Geometry=rdiff)  # -> Area, Centroid
rot3d = Rotate3D(Geometry=rdiff, Angle=1.570796327, Center=area_2.Centroid, Axis="-1,0,0")  # -> Geometry, Transform
