# Grasshopper definition Swirl_00.gh (Grasshopper 1.0.7)

threseholdformiddlepieces = Slider(1.32, range=1..3)
outercircleradius = Slider(13, range=0..100)
innercircleradius = Slider(8, range=0..100)
rectangleside = Slider(200, range=0..1000)
box_thickness = Slider(5, range=1..20)
smooth_subsivisions = Slider(24, range=1..30)
cutcircleradius = Slider(25, range=0..100)
swirlformingcurve = Curve(<curve referenced from the Rhino model>)
panel = Panel([Slider(0.067, range=0..1), Slider(0.268, range=0..1), Slider(0.394, range=0..1), Slider(0.676, range=0..1), Slider(0.532, range=0..1), Slider(0.785, range=0..1), Slider(0.901, range=0..1)])
cp = ControlPoints(Curve=swirlformingcurve)  # -> Points, Weights, Knots

# ---- group: Build Box, No holes yet
division = Division(A=rectangleside, B="2")
neg = Negative(Value=division)
pt = ConstructPoint(XCoordinate=division, YCoordinate=division, ZCoordinate=expr("x*2", division))
pt_2 = ConstructPoint(XCoordinate=neg, YCoordinate=neg, ZCoordinate="0")
box = Box2Pt(PointA=pt_2, PointB=pt, Plane=PlaneXY(0, 0, 0))

# ----
intcrv = Interpolate(Vertices=cp.Points, Degree=3, Periodic=False, KnotStyle=1)  # -> Curve, Length, Domain
reb = RebuildCurve(Curve=intcrv.Curve, Count=smooth_subsivisions, Tangents=False)

# ---- group: Create Triming Modules _ Offset Srf at 1.32
addition = Addition(A=panel, B=".002")  # -> graft(Result)
subtraction = Subtraction(A=panel, B=".004")  # -> graft(Result)
shatter = Shatter(Curve=reparameterize(reb), Parameters=[subtraction, addition])
item = ListItem(List=shatter, Index=1, Wrap=True)
pipe_fortrim = Pipe(Curve=item, Radius=expr("x-1", innercircleradius), Caps=0)

# ----
eval = EvaluateCurve(Curve=reparameterize(reb), Parameter=panel)  # -> Point, Tangent, Angle
circle = CircleCNR(Center=eval.Point, Normal=eval.Tangent, Radius=cutcircleradius)
boundary = BoundarySurfaces(Edges=circle)
area = Area(Geometry=boundary)  # -> Area, Centroid; disabled

len = Length(Curve=reb)
pipe = Pipe(Curve=reb, Radius=innercircleradius, Caps=2)
pipe_2 = Pipe(Curve=reb, Radius=outercircleradius, Caps=2)
scale = Scale(Geometry=box, Center=Point(0, 0, 0), Factor=Slider(0.98, range=0..1))  # -> Geometry, Transform
leng_of_leds_one_direction = Panel(len)

# ---- group: Obtain JOint Pieces
addition_2 = Addition(A=innercircleradius, B=threseholdformiddlepieces)
cluster = Cluster(crv=item, rad_out=addition_2, radius_in=innercircleradius)

# ----
brep = Brep([pipe_2, pipe])
preview = CustomPreview(
    Geometry=pipe,
    Material={diffuse=RGB(221, 160, 221), emission=RGB(66, 48, 66), shine=0.5, specular=RGB(255, 255, 255), transparency=0})  # disabled
preview_2 = CustomPreview(
    Geometry=brep,
    Material={diffuse=RGB(221, 160, 221), emission=RGB(66, 48, 66), shine=0.5, specular=RGB(255, 255, 255), transparency=0})  # disabled

# ---- group: SurfaceForMassCalculation
pipe_3 = Pipe(Curve=reb, Radius=outercircleradius, Caps=0)
pipe_4 = Pipe(Curve=reb, Radius=innercircleradius, Caps=0)
debrep = DeconstructBrep(Brep=pipe_4)  # -> Faces, Edges, Vertices
debrep_2 = DeconstructBrep(Brep=pipe_3)  # -> Faces, Edges, Vertices
item_2 = ListItem(List=debrep.Edges, Index=1, Wrap=True)
item_3 = ListItem(List=debrep_2.Edges, Index=1, Wrap=True)
item_4 = ListItem(List=debrep.Edges, Index=2, Wrap=True)
item_5 = ListItem(List=debrep_2.Edges, Index=2, Wrap=True)
loft = Loft(
    Curves=[item_3, item_2],
    Options={Adjust=False, Closed=False, LoftEnds=0, LoftSimp=0, LoftType=0, Rebuild=10, Refit=0.01})
loft_2 = Loft(
    Curves=[item_5, item_4],
    Options={Adjust=False, Closed=False, LoftEnds=0, LoftSimp=0, LoftType=0, Rebuild=10, Refit=0.01})
brep_2 = Brep(flatten([pipe_3, pipe_4, loft, loft_2]))
join = BrepJoin(Breps=brep_2)  # -> Breps, Closed

# ----
pipe_5 = Pipe(Curve=reb, Radius=expr("x-.88", outercircleradius), Caps=2)

# ---- group: Offset and Extrude Surfaces For Sides
debrep_3 = DeconstructBrep(Brep=scale.Geometry)  # -> graft(Faces), Edges, Vertices
offset = OffsetCurve(Curve=debrep_3.Faces, Distance=expr("x*-1", box_thickness), Corners=1)
path_mapper = PathMapper(offset, source="{a;b;c;d}", target="{a;b;c}")
srfsplit = SurfaceSplit(Surface=debrep_3.Faces, Curves=path_mapper)
item_6 = ListItem(List=srfsplit, Index=0, Wrap=True)

# ---- group: Generate Sides
pt_3 = ConstructPoint(XCoordinate=0, YCoordinate=0, ZCoordinate=0)
evalsrf = EvaluateSurface(Surface=debrep_3.Faces, Point=pt_3)  # -> Point, Normal, UDirection, VDirection, Frame
amp = Amplitude(Vector=evalsrf.Normal, Amplitude=expr("x*-1", box_thickness))
extr = Extrude(Base=path_mapper, Direction=amp)

# ---- group: Offset and Extrude Surfaces For Sides (continued)
join_2 = BrepJoin(Breps=flatten([item_6, extr]))  # -> Breps, Closed
brep_3 = Brep(join_2.Breps)

# ----
preview_3 = CustomPreview(
    Geometry=brep_3,
    Material={diffuse=RGB(221, 160, 221), emission=RGB(66, 48, 66), shine=0.5, specular=RGB(255, 255, 255), transparency=0})  # disabled
sdiff = SolidDifference(BrepsA=flatten(brep_3), BrepsB=flatten(pipe_5))
join_3 = BrepJoin(Breps=[join.Breps, sdiff])  # -> Breps, Closed
sunion = SolidUnion(Breps=join_3.Breps)
volume = Volume(Geometry=sunion)  # -> Volume, Centroid
pt_4 = Point(volume.Centroid)
panel_2 = Panel(volume.Centroid)

# ==== cluster Cluster
crv = ClusterInput()
crv_2 = Curve(crv)
rad_out = ClusterInput()
radius_in = ClusterInput()
pipeout = Pipe(Curve=crv_2, Rad_Out=rad_out, Caps=0)
pipe2 = Pipe(Curve=crv_2, Radius_In=radius_in, Caps=0)
debrep = DeconstructBrep(Brep=pipeout)  # -> Faces, Edges, Vertices
debrep_2 = DeconstructBrep(Brep=pipe2)  # -> Faces, Edges, Vertices
item = ListItem(List=debrep_2.Edges, Index=1, Wrap=True)
item_2 = ListItem(List=debrep.Edges, Index=1, Wrap=True)
item_3 = ListItem(List=debrep_2.Edges, Index=2, Wrap=True)
item_4 = ListItem(List=debrep.Edges, Index=2, Wrap=True)
loft = Loft(Curves=[item_2, item], Options={Adjust=False, Closed=False, LoftEnds=0, LoftSimp=0, LoftType=0, Rebuild=10, Refit=0.01})
loft_2 = Loft(
    Curves=[item_4, item_3],
    Options={Adjust=False, Closed=False, LoftEnds=0, LoftSimp=0, LoftType=0, Rebuild=10, Refit=0.01})
brep = Brep(flatten([pipeout, pipe2, loft, loft_2]))
join = BrepJoin(Breps=brep)  # -> Breps, Closed
brep_2 = Brep(join.Breps)
brep_3 = ClusterOutput(brep_2)
