# Grasshopper definition Pot_Grasshopper.gh (Grasshopper 1.0.7)
# plug-ins: MeshEdit Components, Kangaroo2 Components, LunchBox, Human

mesh_smooth_strength = Slider(1, range=0..1)  # disabled
mesh_smooth_iterations = Slider(12, range=0..100)  # disabled
edges_lenght_factor = Slider(0.64, range=0..1)  # disabled
number_slider = Slider(1, range=1..10)  # disabled
mesh = Mesh(<mesh referenced from the Rhino model>)  # disabled

# ---- group: Scale and Determine VOlume
number_slider_2 = Slider(1.26, range=1..2)  # disabled
brep = Brep([<brep referenced from the Rhino model> x2])  # disabled
scale = Scale(Geometry=brep, Center=Point(0, 0, 0), Factor=number_slider_2)  # -> Geometry, Transform; disabled
volume = Volume(Geometry=scale.Geometry)  # -> Volume, Centroid; disabled
panel = Panel("1000")  # disabled
panel_2 = Panel(volume.Volume)  # disabled
mass_addition = MassAddition(Input=volume.Volume)  # -> Result, PartialResults; disabled
division = Division(A=mass_addition.Result, B=panel)  # disabled
panel_3 = Panel(division)  # disabled

# ----
mesh_weldvertices = MeshWeldVertices(Mesh=mesh, Tolerance=0.01)  # -> RuntimeMessage, Mesh; disabled
mesh_smooth_strength_2 = Slider(1, range=0..1)  # disabled
mesh_smooth_iterations_2 = Slider(12, range=0..100)  # disabled
mesh_smooth_strength_3 = Slider(1, range=0..1)  # disabled
mesh_smooth_iterations_3 = Slider(12, range=0..100)  # disabled
mesh_2 = Mesh([<mesh referenced from the Rhino model> x7])  # disabled
mesh_3 = Mesh(<mesh referenced from the Rhino model>)  # disabled
sphere = Sphere(Base=PlaneXY(-5.018240504, -7.421968694, 0), Radius=number_slider)  # disabled
mesh_sphere = MeshSphere(Base=PlaneXY(0, 0, 0), Radius=number_slider, UCount=10, VCount=20)  # disabled
mesh_colours = MeshColours(
    Mesh=mesh_sphere,
    Colours=[RGB(127, 255, 0), RGB(0, 100, 0), RGB(34, 139, 34), RGB(124, 252, 0), RGB(154, 205, 50), RGB(173, 255, 47), RGB(50, 205, 50), RGB(152, 251, 152)])  # disabled
edges_lenght_factor_2 = Slider(1, range=0..1)  # disabled
edges_lenght_factor_3 = Slider(1, range=0..1)  # disabled
mesh_weldvertices_2 = MeshWeldVertices(Mesh=mesh_2, Tolerance=0.01)  # -> RuntimeMessage, Mesh; disabled
mesh_weldvertices_3 = MeshWeldVertices(Mesh=mesh_3, Tolerance=0.01)  # -> RuntimeMessage, Mesh; disabled
boolean_toggle = BooleanToggle(True)
inflation_ratio = Slider(0.02, range=0..30)
kangaroo_active = BooleanToggle(False)
reset_kangaroo = Button()
mesh2 = Mesh([<mesh referenced from the Rhino model> x2])
bakegeometry = Button()
mesh1 = Mesh([<mesh referenced from the Rhino model> x3])
number_slider_3 = Slider(0.33, range=0..0.5)  # disabled
deconstruct_mesh = DeconstructMesh(Mesh=mesh_colours)  # -> Vertices, Faces, Colours, Normals; disabled
smooth_mesh = SmoothMesh(Mesh=mesh_weldvertices.Mesh, Strength=mesh_smooth_strength, SkipNaked=invert(True), Iterations=mesh_smooth_iterations)  # disabled
boolean_toggle_2 = BooleanToggle(False)  # disabled
number_slider_4 = Slider(16, range=1..50)  # disabled
number_slider_5 = Slider(5, range=1..50)  # disabled
number_slider_6 = Slider(0.41, range=0..5)  # disabled
number_slider_7 = Slider(50, range=1..50)  # disabled
number_slider_8 = Slider(21, range=1..50)  # disabled
mesh_join = MeshJoin(Meshes=mesh_weldvertices_2.Mesh)  # disabled
smooth_mesh_2 = SmoothMesh(Mesh=mesh_join, Strength=mesh_smooth_strength_2, SkipNaked=invert(True), Iterations=mesh_smooth_iterations_2)  # disabled
mesh_join_2 = MeshJoin(Meshes=mesh_weldvertices_3.Mesh)  # disabled
smooth_mesh_3 = SmoothMesh(Mesh=mesh_join_2, Strength=mesh_smooth_strength_3, SkipNaked=invert(True), Iterations=mesh_smooth_iterations_3)  # disabled
vector_display = VectorDisplay(Anchor=deconstruct_mesh.Vertices, Vector=deconstruct_mesh.Normals)  # disabled
nakedvertices = NakedVertices(Mesh=mesh_weldvertices_2.Mesh)  # -> ClothedIndex, NakedIndex, ClothedPts, NakedPts; disabled
nakedvertices_2 = NakedVertices(Mesh=mesh_weldvertices_3.Mesh)  # -> ClothedIndex, NakedIndex, ClothedPts, NakedPts; disabled
surface = Surface(<surface referenced from the Rhino model>)  # disabled

mesh_weldvertices_4 = MeshWeldVertices(Mesh=mesh1, Tolerance=0.01)  # -> RuntimeMessage, Mesh
mesh_join_3 = MeshJoin(Meshes=mesh_weldvertices_4.Mesh)
nakedvertices_3 = NakedVertices(Mesh=mesh_weldvertices_4.Mesh)  # -> ClothedIndex, NakedIndex, ClothedPts, NakedPts
point = Point(nakedvertices_3.NakedPts)
edges_lenght_factor_4 = Slider(1, range=0..1)
anchor = Anchor(Point=point, Strength=10000)
edgelengths = EdgeLengths(Mesh=mesh_join_3, LengthFactor=edges_lenght_factor_4, Strength=1)

skewed_quads = SkewedQuads(Surface=surface, UDivisions=number_slider_5, VDivisions=number_slider_4, TParameter=0)  # -> FullPanels, EdgePanels; disabled
diamond_panels = DiamondPanels(Surface=surface, UDivisions=number_slider_8, VDivisions=number_slider_7)  # -> DiamondPanels, TriPanels; disabled
mesh_4 = Mesh(<mesh referenced from the Rhino model>)  # disabled
smooth = Smooth(M=smooth_mesh, Strength=1)  # disabled
pressure = Pressure(M=smooth_mesh, Strength=number_slider_3)  # disabled
edgelengths_2 = EdgeLengths(Mesh=smooth_mesh, LengthFactor=edges_lenght_factor, Strength=1)  # disabled

nakedvertices_4 = NakedVertices(Mesh=smooth_mesh)  # -> ClothedIndex, NakedIndex, ClothedPts, NakedPts; disabled
anchor_2 = Anchor(Point=nakedvertices_4.NakedPts, Strength=10000)  # disabled

show = Show(G=smooth_mesh)  # disabled
mesh_brep = MeshBrep(Settings={GridMaxCount=0, GridMinCount=16, JaggedSeams=False, MaxEdgeLength=0, MinEdgeLength=0.0001, MinTolerance=0, Refine=True, RefineAngle=0, RelativeTolerance=0.65, SimplePlanes=True, Tolerance=0})  # -> flatten(Mesh); disabled
panel_4 = Panel(".02")  # disabled
point_2 = Point(nakedvertices.NakedPts)  # disabled
point_3 = Point(nakedvertices_2.NakedPts)  # disabled
number_slider_9 = Slider(1, range=-1..1)  # disabled
number_slider_10 = Slider(2, range=0..2)  # disabled
number_slider_11 = Slider(0.0109, range=0..0.06)  # disabled
number_slider_12 = Slider(0.0109, range=0..0.06)  # disabled
construct_point = ConstructPoint(XCoordinate=panel_4, YCoordinate=0, ZCoordinate=0)  # disabled
softbodycollide = SoftBodyCollide(Meshes=[mesh_3, mesh_4], Strength=10)  # disabled
number_slider_13 = Slider(1, range=0..2)  # disabled
edgelengths_3 = EdgeLengths(Mesh=mesh_4, LengthFactor=1, Strength=1)  # disabled
boolean_toggle_3 = BooleanToggle(True)  # disabled
boolean_toggle_4 = BooleanToggle(False)  # disabled
button = Button()  # disabled
button_2 = Button()  # disabled
button_3 = Button()  # disabled
wind = Wind(Mesh=mesh_3, WindVector=construct_point)  # disabled
number_slider_14 = Slider(0.41, range=0..5)  # disabled
number_slider_15 = Slider(0.41, range=0..5)  # disabled
multiplication = Multiplication(A=number_slider_11, B=number_slider_10)  # disabled
multiplication_2 = Multiplication(A=number_slider_12, B=number_slider_13)  # disabled
edgelengths_4 = EdgeLengths(Mesh=mesh_join, LengthFactor=edges_lenght_factor_2, Strength=1)  # disabled
anchor_3 = Anchor(Point=point_3, Strength=10000)  # disabled
nakedvertices_5 = NakedVertices(Mesh=mesh_join_2)  # -> ClothedIndex, NakedIndex, ClothedPts, NakedPts; disabled
solidpointcollide = SolidPointCollide(Points=nakedvertices_5.ClothedPts, Solid=mesh_4, Interior=False, Unidirectional=True, Strength=10)  # disabled
bouncysolver = BouncySolver(
    GoalObjects=[show, edgelengths_2, anchor_2, smooth, pressure],
    Reset=button_3,
    Threshold=1e-15,
    Tolerance=0.0001,
    Damping=0.99,
    Iterations=10,
    On=boolean_toggle_2)  # -> I, V, O; disabled

nakedvertices_6 = NakedVertices(Mesh=mesh_join)  # -> ClothedIndex, NakedIndex, ClothedPts, NakedPts; disabled
anchor_4 = Anchor(Point=point_2, Strength=10000)  # disabled

smooth_2 = Smooth(M=mesh_join, Strength=1)  # disabled
pressure_2 = Pressure(M=mesh_join, Strength=multiplication)  # disabled
smooth_3 = Smooth(M=mesh_join_2, Strength=1)  # disabled
pressure_3 = Pressure(M=mesh_join_2, Strength=multiplication_2)  # disabled
show_2 = Show(G=mesh_join)  # disabled
show_3 = Show(G=[mesh_join_2, mesh_4])  # disabled
edgelengths_5 = EdgeLengths(Mesh=mesh_join, LengthFactor=edges_lenght_factor_2, Strength=1)  # disabled
edgelengths_6 = EdgeLengths(Mesh=mesh_join_2, LengthFactor=edges_lenght_factor_3, Strength=1)  # disabled
mesh_5 = Mesh(mesh_join_3)
curve = Curve()
curve_2 = Curve()  # disabled
list_item = ListItem(List=bouncysolver.O, Index=0, Wrap=True)  # disabled
create_material = CreateMaterial(Diffuse=RGB(250, 202, 202), Specular=RGB(255, 255, 255), Emission=RGB(0, 0, 0), Transparency=0, Shine=10)  # disabled
removeduplicatelines = RemoveDuplicateLines(Tolerance=0.01)
removeduplicatelines_2 = RemoveDuplicateLines(Tolerance=0.01)  # disabled
pressure_4 = Pressure(M=mesh_5, Strength=inflation_ratio)
smooth_4 = Smooth(M=mesh_5, Strength=1)
show_4 = Show(G=mesh_5)
custom_preview = CustomPreview(Geometry=list_item, Material=create_material)  # disabled
bouncysolver_2 = BouncySolver(
    GoalObjects=[show_2, edgelengths_5, anchor_4, smooth_2, pressure_2],
    Reset=button_2,
    Threshold=1e-15,
    Tolerance=0.0001,
    Damping=0.99,
    Iterations=10,
    On=boolean_toggle_3)  # -> I, V, O; disabled
bouncysolver_3 = BouncySolver(
    GoalObjects=[show_3, edgelengths_6, anchor_3, smooth_3, pressure_3, edgelengths_3, softbodycollide, wind, solidpointcollide],
    Reset=button,
    Threshold=1e-15,
    Tolerance=0.0001,
    Damping=0.99,
    Iterations=10,
    On=boolean_toggle_4)  # -> I, V, O; disabled
list_item_2 = ListItem(List=bouncysolver_2.O, Index=0, Wrap=True)  # disabled
list_item_3 = ListItem(List=bouncysolver_3.O, Index=0, Wrap=True)  # disabled
create_material_2 = CreateMaterial(Diffuse=RGB(250, 202, 202), Specular=RGB(255, 255, 255), Emission=RGB(0, 0, 0), Transparency=0, Shine=10)  # disabled
create_material_3 = CreateMaterial(Diffuse=RGB(250, 202, 202), Specular=RGB(255, 255, 255), Emission=RGB(0, 0, 0), Transparency=0, Shine=10)  # disabled
mesh_6 = Mesh()  # disabled
mesh_smooth_strength_4 = Slider(1, range=0..1)  # disabled
mesh_smooth_iterations_4 = Slider(12, range=0..100)  # disabled
custom_preview_2 = CustomPreview(Geometry=list_item_2, Material=create_material_2)  # disabled
custom_preview_3 = CustomPreview(Geometry=list_item_3, Material=create_material_3)  # disabled
edges_lenght_factor_5 = Slider(1, range=0..1)  # disabled
bouncysolver_4 = BouncySolver(
    GoalObjects=[show_4, edgelengths, anchor, smooth_4, pressure_4],
    Reset=reset_kangaroo,
    Threshold=1e-15,
    Tolerance=0.0001,
    Damping=0.99,
    Iterations=10,
    On=kangaroo_active)  # -> I, V, O
create_material_4 = CreateMaterial(Diffuse=RGB(255, 255, 255), Specular=RGB(255, 255, 255), Emission=RGB(0, 0, 0), Transparency=0, Shine=10)
list_item_4 = ListItem(List=bouncysolver_4.O, Index=0, Wrap=True)
custom_preview_4 = CustomPreview(Geometry=list_item_4, Material=create_material_4)  # disabled
bake_geometry = BakeGeometry(Bake=bakegeometry, Geometry=list_item_4, DeleteOldBakes=False, PreserveTrees=False)
panel_5 = Panel(".02")  # disabled
mesh_7 = Mesh(<mesh referenced from the Rhino model>)  # disabled
construct_point_2 = ConstructPoint(XCoordinate=panel_5, YCoordinate=0, ZCoordinate=0)  # disabled
number_slider_16 = Slider(9, range=1..30)  # disabled
number_slider_17 = Slider(6, range=1..6)  # disabled
mesh_8 = Mesh([<mesh referenced from the Rhino model> x2])  # disabled
mesh_9 = Mesh(mesh_8)  # disabled
mesh_weldvertices_5 = MeshWeldVertices(Mesh=mesh_9, Tolerance=0.01)  # -> RuntimeMessage, Mesh; disabled
mesh_10 = Mesh(mesh_weldvertices_5.Mesh)  # disabled
mesh_join_4 = MeshJoin(Meshes=mesh_10)  # disabled
smooth_mesh_4 = SmoothMesh(Mesh=mesh_join_4, Strength=mesh_smooth_strength_4, SkipNaked=invert(True), Iterations=mesh_smooth_iterations_4)  # disabled
nakedvertices_7 = NakedVertices(Mesh=mesh_10)  # -> ClothedIndex, NakedIndex, ClothedPts, NakedPts; disabled
panel_6 = Panel(mesh_join_4)  # disabled
point_4 = Point(nakedvertices_7.NakedPts)  # disabled
boolean_toggle_5 = BooleanToggle(True)  # disabled
button_4 = Button()  # disabled
wind_2 = Wind(Mesh=mesh_weldvertices_5.Mesh, WindVector=construct_point_2)  # disabled
softbodycollide_2 = SoftBodyCollide(Meshes=[mesh_weldvertices_5.Mesh, mesh_7], Strength=10)  # disabled
edgelengths_7 = EdgeLengths(Mesh=mesh_7, LengthFactor=1, Strength=1)  # disabled
number_slider_18 = Slider(0.0109, range=0..0.06)  # disabled
number_slider_19 = Slider(0.41, range=0..5)  # disabled
multiplication_3 = Multiplication(A=number_slider_18, B=number_slider_16)  # disabled
nakedvertices_8 = NakedVertices(Mesh=mesh_join_4)  # -> ClothedIndex, NakedIndex, ClothedPts, NakedPts; disabled
solidpointcollide_2 = SolidPointCollide(Points=nakedvertices_8.ClothedPts, Solid=mesh_7, Interior=False, Unidirectional=True, Strength=10)  # disabled
anchor_5 = Anchor(Point=point_4, Strength=10000)  # disabled
smooth_5 = Smooth(M=mesh_join_4, Strength=1)  # disabled
pressure_5 = Pressure(M=mesh_join_4, Strength=multiplication_3)  # disabled
show_5 = Show(G=[mesh_join_4, mesh_7])  # disabled
edgelengths_8 = EdgeLengths(Mesh=mesh_join_4, LengthFactor=edges_lenght_factor_5, Strength=1)  # disabled
curve_3 = Curve()  # disabled
removeduplicatelines_3 = RemoveDuplicateLines(Tolerance=0.01)  # disabled
bouncysolver_5 = BouncySolver(
    GoalObjects=[show_5, edgelengths_8, anchor_5, smooth_5, pressure_5, edgelengths_7, softbodycollide_2, wind_2, solidpointcollide_2],
    Reset=button_4,
    Threshold=1e-15,
    Tolerance=0.0001,
    Damping=0.99,
    Iterations=10,
    On=boolean_toggle_5)  # -> I, V, O; disabled
list_item_5 = ListItem(List=bouncysolver_5.O, Index=0, Wrap=True)  # disabled
create_material_5 = CreateMaterial(Diffuse=RGB(250, 202, 202), Specular=RGB(255, 255, 255), Emission=RGB(0, 0, 0), Transparency=0, Shine=10)  # disabled
custom_preview_5 = CustomPreview(Geometry=list_item_5, Material=create_material_5)  # disabled
